# Grasshopper definition VoxelDataStructure.gh (Grasshopper 0.9.76)
# plug-ins: Python Interpreter

python = PythonScript()  # -> out, VoxelMap
# ---------- python: Python ----------
import Rhino as r
class VoxelMap():
    pixels = []
# ---------- end python ----------
python_2 = PythonScript()  # -> out, Pixel
# ---------- python_2: Python ----------
import Rhino as r

class Pixel():
    p0 = [];
    p1 = [];
    pmid = [];
    i = -1; 
    j = -1;
    k = -1;
    npix = []

    occupancy = 0.0;
    occupancyTemp = 0.0;
    friction = 0.0;
    isSolid = False;
    isFixed = False;
    staticFlow = [0,0,0]
    flow = [0,0,0]

    def GetCenterPt(self):
        return r.Geometry.Point3d(self.pmid[0], self.pmid[1], self.pmid[2])
# ---------- end python_2 ----------
python_3 = PythonScript(VoxelMap=python.VoxelMap, Pixel=python_2.Pixel)  # -> out, a
# ---------- python_3: Python ----------
import Rhino as r

thePixel = Pixel()
thePixel.pmid = [1,2,0]

a = thePixel.GetCenterPt();
# ---------- end python_3 ----------
panel = Panel(python_3.a)
